# Grasshopper definition Suzanne Mill v0.gh (Grasshopper 1.0.7)
# plug-ins: Mesh Pipe, Kangaroo2 Components

number_slider = Slider(0.01, range=0..0.01)
# Created By Quan Li
# 
# https://discourse.mcneel.com/u/quan_li/summary
# 
# https://www.instagram.com/mearisori/
number_slider_2 = Slider(100, range=0..100)
trigger = Trigger(Interval=50, TimerInterval=50, Target=[addition, addition_2, addition_3])
mesh = Mesh([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])
addition = Addition(A=number_slider, B=number_slider)
sz = ScaleToSize(geo=mesh, Y=number_slider_2)  # -> G, X_3
rec = DataRecorder(addition, DataLimit=-10, RecordData=True)
dendro_invalid_mesh_repair = DendroInvalidMesh(Mcheck=sz.G)  # -> M; inputs Mcheck: Mesh
# ---------- dendro_invalid_mesh_repair: C# ----------
    if (!Mcheck.IsValid)
    {
      Mesh result = Mcheck.DuplicateMesh();
      Mcheck.Vertices.CombineIdentical(true, true);
      Mcheck.Faces.CullDegenerateFaces();
      Mcheck.Vertices.CullUnused();
      Mcheck.RebuildNormals();
    }
    M = Mcheck;
# ---------- end dendro_invalid_mesh_repair ----------
ma = MassAddition(Input=rec)  # -> Result, PartialResults
move_to_origin = MoveToOrigin(geo=dendro_invalid_mesh_repair)
sin = Sine(Value=ma.Result)
pi = Pi(Factor=sin)
size = Size(geo=move_to_origin)
multiplication = Multiplication(A=pi, B=Slider(0.25, range=0..1))
smooth = SmoothNumbers(Numbers=multiplication, SmoothDelay=3000)
xy = XYPlane(Origin=Point(0, 0, 0))
panel = Panel(smooth)
rotate = Rotate(Geometry=xy, Angle=smooth, Plane=xy)  # -> Geometry, Transform
number_slider_3 = Slider(0.003, range=0..0.01)
line = LineSDL(Start=xy, Direction=Vector(0, 0, 1), Length=152)
deplane = DeconstructPlane(Plane=rotate.Geometry)  # -> Origin, XAxis, YAxis, ZAxis
addition_2 = Addition(A=number_slider_3, B=number_slider_3)
end = EndPoints(Curve=line)  # -> Start, End
rec_2 = DataRecorder(addition_2, DataLimit=-10, RecordData=True)
line_2 = LineSDL(Start=end.End, Direction=deplane.XAxis, Length=15)
mpipe = MeshPipe(Curve=[line, line_2], Radius=Slider(1.7, range=0..10), Accuracy=0.2, Rotation=0, Segments=10, Caps=2)
clean = CombineClean(Meshes=mpipe)
ma_2 = MassAddition(Input=rec_2)  # -> Result, PartialResults
multiplication_2 = Multiplication(A=ma_2.Result, B=Slider(5, range=0..10))
end_2 = EndPoints(Curve=line_2)  # -> Start, End

line_3 = Line(line_2)
vec = Vector(line_3)
xprod = CrossProduct(VectorA=vec, VectorB=Vector(0, 0, 1), Unitize=False)  # -> Vector, Length
pl = ConstructPlane(Origin=end_2.End, XAxis=expr("-x", xprod.Vector), YAxis=expr("-x", line_3))
monkey = Monkey(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)
scale_center = ScaleCenter(G=monkey, F=Slider(0.3, range=0..1))  # -> G_2, pt
xy_2 = XYPlane(Origin=Point(0, 0, 0))
orient = Orient(Geometry=scale_center.G_2, Source=xy_2, Target=pl)  # -> Geometry, Transform

number_slider_4 = Slider(0.01, range=0..0.01)
pl_2 = ConstructPlane(Origin=end_2.End, XAxis=deplane.YAxis, YAxis=Vector(0, 0, 1))
smooth_2 = SmoothNumbers(Numbers=multiplication_2, SmoothDelay=2000)
cir = Circle(Plane=pl_2, Radius=10)
pi_2 = Pi(Factor=smooth_2)
addition_3 = Addition(A=number_slider_4, B=number_slider_4)
rotate_2 = Rotate(Geometry=cir, Angle=pi_2, Plane=pl_2)  # -> Geometry, Transform
rec_3 = DataRecorder(addition_3, DataLimit=-10, RecordData=True)
divide = DivideCurve(Curve=rotate_2.Geometry, Count=3, Kinks=False)  # -> Points, Tangents, Parameters
ma_3 = MassAddition(Input=rec_3)  # -> Result, PartialResults
vec2pt = Vector2Pt(PointA=end_2.End, PointB=divide.Points, Unitize=False)  # -> Vector, Length
sin_2 = Sine(Value=ma_3.Result)
pi_3 = Pi(Factor=sin_2)
xprod_2 = CrossProduct(VectorA=divide.Tangents, VectorB=vec2pt.Vector, Unitize=False)  # -> Vector, Length
smooth_3 = SmoothNumbers(Numbers=pi_3, SmoothDelay=10000)
pl_3 = ConstructPlane(Origin=divide.Points, XAxis=divide.Tangents, YAxis=xprod_2.Vector)
rotate_3 = Rotate(Geometry=pl_3, Angle=smooth_3, Plane=pl_3)  # -> Geometry, Transform
deplane_2 = DeconstructPlane(Plane=rotate_3.Geometry)  # -> Origin, XAxis, YAxis, ZAxis
padjust = AdjustPlane(Plane=rotate_3.Geometry, Normal=deplane_2.YAxis)
rectangle = Rectangle(Plane=padjust, XSize=Domain(3, -3), YSize=Domain(0, 50), Radius=0)  # -> Rectangle, Length
boundary = BoundarySurfaces(Edges=rectangle.Rectangle)

# ==== cluster ScaleToSize: Scale to Exact Size If you input 1 value it will scale uniformly with that one value.
# Created By Quan Li
# 
# https://discourse.mcneel.com/u/quan_li/summary
# 
# https://www.instagram.com/mearisori/
geo = ClusterInput()
geo_2 = Geometry(flatten(geo))
X = ClusterInput()
Y = ClusterInput()
Z = ClusterInput()
bbox = BoundingBox(Content=geo_2, Plane=PlaneXY(0, 0, 0), UnionBox=True)  # -> Box, Box_2
X_2 = Number(X)
Y_2 = Number(Y)
Z_2 = Number(Z)
boxprop = BoxProperties(Box=bbox.Box)  # -> Center, Diagonal, Area, Volume, Degeneracy
pdecon = Deconstruct(Point=boxprop.Diagonal)  # -> XComponent, YComponent, ZComponent
pdecon_2 = Deconstruct(Point=boxprop.Diagonal)  # -> XComponent, YComponent, ZComponent
set_initial_value_of_a_cluster = InitialValueOfACluster(new_value=X_2, initial_value=pdecon_2.XComponent)
set_initial_value_of_a_cluster_2 = InitialValueOfACluster(new_value=Y_2, initial_value=pdecon_2.YComponent)
set_initial_value_of_a_cluster_3 = InitialValueOfACluster(new_value=Z_2, initial_value=pdecon_2.ZComponent)
division = Division(A=X, B=pdecon.XComponent)
division_2 = Division(A=Y, B=pdecon.YComponent)
division_3 = Division(A=Z, B=pdecon.ZComponent)
merge = Merge(Data1=division, Data2=division_2, Data3=division_3)
merge_2 = Merge(Data1=X, Data2=Y, Data3=Z)
division_4 = Division(A=set_initial_value_of_a_cluster, B=pdecon_2.XComponent)
division_5 = Division(A=set_initial_value_of_a_cluster_2, B=pdecon_2.YComponent)
division_6 = Division(A=set_initial_value_of_a_cluster_3, B=pdecon_2.ZComponent)
lng = ListLength(List=merge_2)
merge_3 = Merge(Data1=division_4, Data2=division_5, Data3=division_6)
equals = Equality(FirstNumber=lng, SecondNumber=1)  # -> Equality, Inequality
num = Number(merge)
repeat = RepeatData(Data=num, Length=3)
set_initial_value_of_a_cluster_4 = InitialValueOfACluster(new_value=equals.Equality, initial_value=Slider(2, range=0..100))
panel = Panel("""1
1
1""")
filter = StreamFilter(Gate=set_initial_value_of_a_cluster_4, Stream0=merge_3, Stream1=repeat, Stream2=panel)
item = ListItem(List=filter, Index=0, Wrap=True)  # -> Item, Item1, Item2
null = NullItem(Item=item.Item2)  # -> NullFlags, InvalidFlags, Description
expression = Expression(x=null.NullFlags, y=item.Item2, Expression="if(x = True,1,y)")
scale_nu = ScaleNU(Geometry=geo_2, Plane=boxprop.Center, ScaleX=item.Item, ScaleY=item.Item1, ScaleZ=expression)  # -> Geometry, Transform
size = Size(geo=scale_nu.Geometry)
G = ClusterOutput(scale_nu.Geometry)
preview = CustomPreview(
    Geometry=scale_nu.Geometry,
    Material={diffuse=RGB(255, 255, 255), emission=RGB(0, 0, 0), shine=0, specular=RGB(255, 255, 255), transparency=0})
X_3 = ClusterOutput(scale_nu.Transform)

# ==== cluster MoveToOrigin: Choose above to put it just above the xy center

# ---- group: Above or at the origin?
filter = StreamFilter(Gate=Toggle(False), Stream0=Slider(0, range=0..100), Stream1=Slider(0.5, range=0..1))

# ----
geo = ClusterInput()
geo_2 = Geometry(geo)
bbox = BoundingBox(Content=geo_2, Plane=PlaneXY(0, 0, 0), UnionBox=True)  # -> Box, Box_2
box = EvaluateBox(Box=bbox.Box, UParameter=0.5, VParameter=0.5, WParameter=filter)  # -> Plane, Point, Include
xy = XYPlane(Origin=Point(0, 0, 0))
vec2pt = Vector2Pt(PointA=box.Point, PointB=xy, Unitize=False)  # -> Vector, Length
move = Move(Geometry=geo_2, Motion=vec2pt.Vector)  # -> Geometry, Transform
G = ClusterOutput(move.Geometry)

# ==== cluster ScaleCenter: Scale From Center
# Created By Quan Li
# 
# https://discourse.mcneel.com/u/quan_li/summary
# 
# https://www.instagram.com/mearisori/
G = ClusterInput()
F = ClusterInput()
bbox = BoundingBox(Content=G, Plane=PlaneXY(0, 0, 0), UnionBox=True)  # -> Box, Box_2
box = EvaluateBox(Box=bbox.Box, UParameter=0.5, VParameter=0.5, WParameter=0.5)  # -> Plane, Point, Include
scale = Scale(Geometry=G, Center=box.Point, Factor=F)  # -> Geometry, Transform
pt = ClusterOutput(box.Point)
G_2 = ClusterOutput(scale.Geometry)

# ==== cluster InitialValueOfACluster: For adding a cluster initial values https://discourse.mcneel.com/t/how-to-set-initial-values-of-a-cluster/162514/2?u=quan_li
initial_value = ClusterInput()
new_value = ClusterInput()
new_value_2 = Data(new_value)
plane = NullItem(NewValue=new_value_2)  # -> NullFlags, InvalidFlags, Description
initial_value_2 = Data(initial_value)
filter = StreamFilter(Gate=plane.InvalidFlags, Stream0=new_value_2, Stream1=initial_value_2)
output = Data(filter)
output_2 = ClusterOutput(output)

# ==== cluster Size: it shows XYZ dimensions
geo = ClusterInput()
geo_2 = Geometry(flatten(geo))
bbox = BoundingBox(Content=geo_2, Plane=PlaneXY(0, 0, 0), UnionBox=True)  # -> Box, Box_2
debrep = DeconstructBrep(Brep=bbox.Box)  # -> Faces, Edges, Vertices
item = ListItem(
    List=debrep.Vertices,
    Index=[Slider(1, range=0..10), Slider(5, range=0..10), Slider(8, range=0..10), Slider(10, range=0..10)],
    Wrap=True)
boxprop = BoxProperties(Box=bbox.Box)  # -> Center, Diagonal, Area, Volume, Degeneracy
item_2 = ListItem(List=item, Index=0, Wrap=True)  # -> Item, Item1, Item2, Item3
ln = Line(StartPoint=item_2.Item, EndPoint=item_2.Item3)
ln_2 = Line(StartPoint=item_2.Item, EndPoint=item_2.Item2)
ln_3 = Line(StartPoint=item_2.Item, EndPoint=item_2.Item1)
dist = Distance(PointA=item_2.Item, PointB=item_2.Item2)
dist_2 = Distance(PointA=item_2.Item, PointB=item_2.Item3)
dist_3 = Distance(PointA=item_2.Item, PointB=item_2.Item1)

pdecon = Deconstruct(Point=boxprop.Diagonal)  # -> XComponent, YComponent, ZComponent
line = Line(ln_2)
number_slider = Slider(0.05, range=0..0.15)
avr = Average(Input=[pdecon.ZComponent, pdecon.XComponent, pdecon.YComponent])
midpt = CurveMiddle(Curve=line)
multiplication = Multiplication(A=avr, B=number_slider)
vec2pt = Vector2Pt(PointA=boxprop.Center, PointB=midpt, Unitize=False)  # -> Vector, Length
amp = Amplitude(Vector=vec2pt.Vector, Amplitude=multiplication)
move = Move(Geometry=line, Motion=amp)  # -> Geometry, Transform

pdecon_2 = Deconstruct(Point=boxprop.Diagonal)  # -> XComponent, YComponent, ZComponent
number_slider_2 = Slider(0.03, range=0..0.15)
line_2 = Line(ln)
avr_2 = Average(Input=[pdecon_2.ZComponent, pdecon_2.XComponent, pdecon_2.YComponent])
midpt_2 = CurveMiddle(Curve=line_2)
multiplication_2 = Multiplication(A=avr_2, B=number_slider)
vec2pt_2 = Vector2Pt(PointA=boxprop.Center, PointB=midpt_2, Unitize=False)  # -> Vector, Length
amp_2 = Amplitude(Vector=vec2pt_2.Vector, Amplitude=multiplication_2)
move_2 = Move(Geometry=line_2, Motion=amp_2)  # -> Geometry, Transform

pdecon_3 = Deconstruct(Point=boxprop.Diagonal)  # -> XComponent, YComponent, ZComponent
line_3 = Line(ln_3)
number_slider_3 = Slider(0.03, range=0..0.15)
avr_3 = Average(Input=[pdecon_3.ZComponent, pdecon_3.XComponent, pdecon_3.YComponent])
midpt_3 = CurveMiddle(Curve=line_3)
multiplication_3 = Multiplication(A=avr_3, B=number_slider)
vec2pt_3 = Vector2Pt(PointA=boxprop.Center, PointB=midpt_3, Unitize=False)  # -> Vector, Length
amp_3 = Amplitude(Vector=vec2pt_3.Vector, Amplitude=multiplication_3)
move_3 = Move(Geometry=line_3, Motion=amp_3)  # -> Geometry, Transform

number_slider_4 = Slider(0.032, range=0..0.15)
multiplication_4 = Multiplication(A=dist_3, B=number_slider_4)
multiplication_5 = Multiplication(A=dist, B=number_slider_4)
multiplication_6 = Multiplication(A=dist_2, B=number_slider_4)
expression = Expression(x=dist, Expression="Round(x,1)")
expression_2 = Expression(x=dist_2, Expression="Round(x,1)")
expression_3 = Expression(x=dist_3, Expression="Round(x,1)")
merge = Merge(Data1=multiplication_5, Data2=multiplication_6, Data3=multiplication_4)  # -> graft(Result)
avr_4 = Average(Input=[multiplication_5, multiplication_6, multiplication_4])
concat = Concatenate(FragmentA="Y ", FragmentB=expression_2)
concat_2 = Concatenate(FragmentA="X ", FragmentB=expression)
concat_3 = Concatenate(FragmentA="Z ", FragmentB=expression_3)
merge_2 = Merge(Data1=move.Geometry, Data2=move_2.Geometry, Data3=move_3.Geometry)
merge_3 = Merge(Data1=concat_2, Data2=concat, Data3=concat_3)
linedim = LineDimension(Line=merge_2, Text=merge_3, Size=avr_4)
